# Grasshopper definition Grasshopper.gh (Grasshopper 1.0.7)

# ----
# FIND PYTHON CODE
# Import the source code of project
reset_address = Button(ExpressionNormal="True", ExpressionPressed="False")
address_finder = CSharpScript(Activate=reset_address)  # -> Address; inputs Activate: Boolean
# ---------- address_finder: C# ----------
    if (Activate)    Address = GrasshopperDocument.FilePath;
# ---------- end address_finder ----------
setaddresses = GhPythonScript(Address=address_finder)  # -> SourcecodeAddress
# ---------- setaddresses: Python ----------
# Addresses
FolderAddress = "\\".join(Address.split("\\")[:-1])
SourcecodeAddress = FolderAddress + "\\Sourcecode.py"
# ---------- end setaddresses ----------
file = ReadFile(File=setaddresses, PerLineParse=False)
source_code = Data(file)

z_factor = Slider(1.1, range=1.1..5)
y_factor = Slider(1.1, range=1.1..5)
x_factor = Slider(1.1, range=1.1..5)
merge = Merge(Data1=x_factor, Data2=y_factor, Data3=z_factor)

fe_destination_center = Point(<point referenced from the Rhino model>)
fe_destination_radius = Slider(83, range=0..200)
eye = Point(<point referenced from the Rhino model>)
target = Point(<point referenced from the Rhino model>)

projection_width = Slider(164.4, range=20..200)
projection_height = Slider(108.3, range=20..200)
eye_height = Slider(63.37, range=-150..150)
p2_projection_center = Point(<point referenced from the Rhino model>)
p2_plane = Plane(Plane(origin=(910, 1220, 0), x=(-1, 0, 0), y=(0, -1, 0)))

main_o = Point(<point referenced from the Rhino model>)
main_x = Point(<point referenced from the Rhino model>)
main_y = Point(<point referenced from the Rhino model>)
main_z = Point(<point referenced from the Rhino model>)
merge_2 = Merge(Data1=main_o, Data2=main_x, Data3=main_y, Data4=main_z)

projected_o = Point(<point referenced from the Rhino model>)
projected_x = Point(<point referenced from the Rhino model>)
projected_y = Point(<point referenced from the Rhino model>)
projected_z = Point(<point referenced from the Rhino model>)
merge_3 = Merge(Data1=projected_o, Data2=projected_x, Data3=projected_y, Data4=projected_z)

# ----
# Code Configuration
mesh_default_color = ColourSwatch(SwatchColor=RGB(82, 156, 128))
_2p_activate = BooleanToggle(True)
_3p_activate = BooleanToggle(True)
_5p_activate = BooleanToggle(True)
activate = BooleanToggle(True)

# ----
# Fish-Eye Perspective Data
preview = Preview_2(destination_center=fe_destination_center, destination_radius=fe_destination_radius, eye=eye, target=target)

# ----
# 3-Point Perspective Data
preview_2 = Preview(main_points_o_x_y_z=merge_2, destination_points_o_x_y_z=merge_3, relay=merge)

# ----
# 2-Point Perspective Data
preview_3 = Preview_3(relay_4=p2_plane, relay_5=eye_height, relay=p2_projection_center, relay_2=projection_width, relay_3=projection_height)

# ----
# Input Data
input_breps = Brep(<brep referenced from the Rhino model>)
input_points = Point()
input_curves_polylines = Curve([<curve referenced from the Rhino model> x25])
input_meshes = Mesh(<mesh referenced from the Rhino model>)
debrep = DeconstructBrep(Brep=input_breps)  # -> Faces, flatten(Edges), flatten(Vertices)
mesh = MeshBrep(
    Brep=input_breps,
    Settings={GridMaxCount=0, GridMinCount=16, JaggedSeams=False, MaxEdgeLength=10, MinEdgeLength=0.0001, MinTolerance=0, Refine=True, RefineAngle=0, RelativeTolerance=0.65, SimplePlanes=True, Tolerance=0})
points = Merge(Data1=input_points, Data2=debrep.Vertices)
polylines = Merge(Data1=debrep.Edges, Data2=input_curves_polylines)

mesh_2 = Mesh(input_breps)

meshes = Merge(Data1=mesh_2, Data2=input_meshes)

perspective = GhPythonScript(
    Code=source_code,
    ACTIVATE=activate,
    P2_ACTIVATE=_2p_activate,
    P2_PLANE=p2_plane,
    P2_EYE_HEIGHT=eye_height,
    P2_PROJECTION_CENTER=p2_projection_center,
    P2_PROJECTION_WIDTH=projection_width,
    P2_PROJECTION_HEIGHT=projection_height,
    P3_ACTIVATE=_3p_activate,
    P3_GEOMETRIC_POINTS=merge_2,
    P3_PROJECTED_POINTS=merge_3,
    P3_PERSPECTIVE_FACTORS=merge,
    FE_ACTIVATE=_5p_activate,
    FE_EYE=eye,
    FE_TARGET=target,
    FE_DESTINATION_CENTER=fe_destination_center,
    FE_DESTINATION_RADIUS=fe_destination_radius,
    MESH_DEFAULT_COLOR=mesh_default_color,
    TOLERANCE="30",
    POINTS=points,
    POLYLINES=polylines,
    MESHES=meshes)  # -> Out, OUTPUT_POINTS, OUTPUT_POLYLINES, OUTPUT_MESHES
panel = Panel(perspective.Out)
pt = Point(perspective.OUTPUT_POINTS)
mesh_3 = Mesh(perspective.OUTPUT_MESHES)
crv = Curve(perspective.OUTPUT_POLYLINES)
preview_4 = CustomPreview(Geometry=crv, Material=ColourSwatch(SwatchColor=RGB(0, 0, 0)))

# ==== cluster Preview
destination_points_o_x_y_z = ClusterInput()
main_points_o_x_y_z = ClusterInput()
relay = ClusterInput()
item = ListItem(List=destination_points_o_x_y_z, Index=1, Wrap=True)  # -> Item, Item1, Item2
item_2 = ListItem(List=destination_points_o_x_y_z, Index=0, Wrap=True)
vec2pt = Vector2Pt(PointA=item_2, PointB=[item.Item, item.Item1, item.Item2], Unitize=False)  # -> Vector, Length
multiplication = Multiplication(A=vec2pt.Vector, B=relay)
move = Move(Geometry=item_2, Motion=multiplication)  # -> Geometry, Transform
tag = TextTag(Location=destination_points_o_x_y_z, Text=["O", "X", "Y", "Z"])
tag_2 = TextTag(Location=main_points_o_x_y_z, Text=["O", "X", "Y", "Z"])

# ==== cluster Preview_2
target = ClusterInput()
eye = ClusterInput()
destination_center = ClusterInput()
destination_radius = ClusterInput()

target_2 = Point(target)
eye_2 = Point(eye)
vec2pt = Vector2Pt(PointA=eye_2, PointB=target_2, Unitize=True)  # -> Vector, Length
pl = PlaneNormal(Origin=eye_2, ZAxis=vec2pt.Vector)
arc = Arc(Plane=pl, Radius="50", Angle=Domain(0, 3.141592654))  # -> Arc, Length
end = EndPoints(Curve=arc.Arc)  # -> Start, End
ln = Line(StartPoint=end.End, EndPoint=end.Start)
cir = Circle(Plane=pl, Radius="50")
revsrf = Revolution(Curve=arc.Arc, Axis=ln, Domain=Domain(0, 3.141592654))
boundary = BoundarySurfaces(Edges=cir)

order = PointOrder(Points=[eye_2, target_2])
cir_2 = Circle(Plane=destination_center, Radius=destination_radius)

# ==== cluster Preview_3
relay = ClusterInput()
relay_2 = ClusterInput()
relay_3 = ClusterInput()
relay_4 = ClusterInput()
relay_5 = ClusterInput()
Z = UnitZ(Factor=relay_5)
move = Move(Geometry=relay_4, Motion=Z)  # -> Geometry, Transform
X = UnitX(Factor=expr("-x", relay_2))
Y = UnitY(Factor=expr("-x", relay_3))
X_2 = UnitX(Factor=relay_2)
deplane = DeconstructPlane(Plane=move.Geometry)  # -> Origin, XAxis, YAxis, ZAxis
amp = Amplitude(Vector=deplane.XAxis, Amplitude="150")
move_2 = Move(Geometry=relay, Motion=X_2)  # -> Geometry, Transform
move_3 = Move(Geometry=relay, Motion=Y)  # -> Geometry, Transform
move_4 = Move(Geometry=relay, Motion=X)  # -> Geometry, Transform
amp_2 = Amplitude(Vector=deplane.YAxis, Amplitude="150")
move_5 = Move(Geometry=deplane.Origin, Motion=[amp, amp_2])  # -> Geometry, Transform
ln = Line(StartPoint=move_4.Geometry, EndPoint=move_2.Geometry)
ln_2 = Line(StartPoint=move_3.Geometry, EndPoint=move_2.Geometry)
ln_3 = Line(StartPoint=move_3.Geometry, EndPoint=move_4.Geometry)
vdis = VectorDisplay(Anchor=deplane.Origin, Vector=amp)
tag = TextTag(Location=[deplane.Origin, move_5.Geometry], Text=["O", "X", "Y"])
vdis_2 = VectorDisplay(Anchor=deplane.Origin, Vector=amp_2)
