# Grasshopper definition Integrated - 24-07-03-01.gh (Grasshopper 1.0.7)
# plug-ins: Telepathy

fe_destination_radius = Slider(200, range=0..200)
fe_destination_center = Point(<point referenced from the Rhino model>)
eye = Point(<point referenced from the Rhino model>)
target = Point(<point referenced from the Rhino model>)

z_factor = Slider(1.1, range=1.1..5)
y_factor = Slider(1.1, range=1.1..5)
x_factor = Slider(1.1, range=1.1..5)
merge = Merge(Data1=x_factor, Data2=y_factor, Data3=z_factor)

# ---- group: Reset All
reset_all = Button()
panel = Panel("True")
reset_all_2 = RemoteSender(reset_all)

# ----
main_o = Point(<point referenced from the Rhino model>)
main_y = Point(<point referenced from the Rhino model>)
main_z = Point(<point referenced from the Rhino model>)
main_x = Point(<point referenced from the Rhino model>)
merge_2 = Merge(Data1=main_o, Data2=main_x, Data3=main_y, Data4=main_z)

indicator = Curve(<curve referenced from the Rhino model>)
prepareplane = PreparePlane(curve=indicator)
projection_height = Slider(132.5, range=20..200)
projection_width = Slider(200, range=20..200)
eye_height = Slider(150, range=-150..150)
p2_projection_center = Point(<point referenced from the Rhino model>)
p2_plane = Plane(prepareplane)

projected_o = Point(<point referenced from the Rhino model>)
projected_y = Point(<point referenced from the Rhino model>)
projected_x = Point(<point referenced from the Rhino model>)
projected_z = Point(<point referenced from the Rhino model>)
merge_3 = Merge(Data1=projected_o, Data2=projected_x, Data3=projected_y, Data4=projected_z)

path_codebase = RemoteSender("D:\Desktop\Portfolio\5. Perspective Maker\Integrated")

# ----
# Fish-Eye Perspective Data
preview = Preview_2(destination_center=fe_destination_center, destination_radius=fe_destination_radius, eye=eye, target=target)

# ----
# 3-Point Perspective Data
preview_2 = Preview(main_points_o_x_y_z=merge_2, destination_points_o_x_y_z=merge_3, relay=merge)

# ----
# Code Configuration
mesh_default_color = ColourSwatch(SwatchColor=RGB(104, 82, 156))
_2p_activate = BooleanToggle(False)
_3p_activate = BooleanToggle(True)
_5p_activate = BooleanToggle(True)
activate = BooleanToggle(False)
panel_2 = Panel("30")

# ---- group: Load Code
path_codebase_2 = RemoteReceiver(path_codebase)
activate_2 = BooleanToggle(True)
reset = Button()
reset_all_3 = RemoteReceiver(reset_all_2)
loadcode = GhPythonScript(ACTIVATE=activate_2, RESET=reset, RESET_ALL=reset_all_3, FolderPath=path_codebase_2, FileName="code3")  # -> Code; inputs ACTIVATE: Boolean, RESET: Boolean, RESET_ALL: Boolean
# ---------- loadcode: Python ----------
if ACTIVATE and not RESET and not RESET_ALL:
    with open(FolderPath + "\\" + FileName + ".py","r") as c:
        Code = c.read()
# ---------- end loadcode ----------

# ----
# 2-Point Perspective Data
preview_3 = Preview_3(relay_4=p2_plane, relay_5=eye_height, relay=p2_projection_center, relay_2=projection_width, relay_3=projection_height)

# ----
# Input Data
input_breps = Brep(<brep referenced from the Rhino model>)
input_points = Point()
input_curves_polylines = Curve()
input_meshes = Mesh()
debrep = DeconstructBrep(Brep=input_breps)  # -> Faces, flatten(Edges), flatten(Vertices)
mesh = MeshBrep(
    Brep=input_breps,
    Settings={GridMaxCount=0, GridMinCount=16, JaggedSeams=False, MaxEdgeLength=10, MinEdgeLength=0.0001, MinTolerance=0, Refine=True, RefineAngle=0, RelativeTolerance=0.65, SimplePlanes=True, Tolerance=0})
points = Merge(Data1=input_points, Data2=debrep.Vertices)
polylines = Merge(Data1=debrep.Edges, Data2=input_curves_polylines)

mesh_2 = Mesh(input_breps)

meshes = Merge(Data1=mesh_2, Data2=input_meshes)

_2points_perspective = CSharpScript(
    Curves=polylines,
    Points=points,
    Meshes=meshes,
    Tolerance="10",
    Plane=p2_plane,
    EyeHeight=eye_height,
    ProjectionCenter=p2_projection_center,
    ProjectionWidth=projection_width,
    ProjectionHeight=projection_height,
    Reference="D:\desktop\Portfolio\5. Perspective Maker\Integrated\24-07-02 Perspective Projection.dll")  # -> out, Points, Curves, Meshes; inputs Curves: list of Curve, Points: list of Point3d, Meshes: list of Mesh, Tolerance: Double, Plane: Plane, EyeHeight: Double, ProjectionCenter: Point3d, ProjectionWidth: Double, ProjectionHeight: Double
# ---------- _2points_perspective: C# usings ----------
using PeHash;
# ---------- _2points_perspective: C# ----------
    TwoPoints Perspective = new PeHash.TwoPoints(Plane, EyeHeight, ProjectionCenter, ProjectionWidth, ProjectionHeight);
    List<Point3d> points = new List<Point3d>();
    List<Mesh> meshes = new List<Mesh>();
    Polyline[] curves;

    foreach(Point3d p in Points){
      points.Add(Perspective.Project(p));
    }
    foreach(Mesh m in Meshes){
      meshes.Add(Perspective.ProjectMesh(m));
    }
    curves = Perspective.ProjectCurves(Curves.ToArray(), Tolerance);

    Points_ = points;
    Curves_ = curves;
    Meshes_ = meshes;
# ---------- end _2points_perspective ----------
_3points_perspective = CSharpScript(
    Curves=polylines,
    Points=points,
    Meshes=meshes,
    Tolerance="10",
    GeometricPoints=merge_2,
    ProjectedPoints=merge_3,
    PerspectiveFactors=merge,
    Reference="D:\desktop\Portfolio\5. Perspective Maker\Integrated\24-07-02 Perspective Projection.dll")  # -> out, Points, Curves, Meshes; inputs Curves: list of Curve, Points: list of Point3d, Meshes: list of Mesh, Tolerance: Double, GeometricPoints: list of Point3d, ProjectedPoints: list of Point3d, PerspectiveFactors: list of Double
# ---------- _3points_perspective: C# ----------
    ThreePoints Perspective = new PeHash.ThreePoints(GeometricPoints.ToArray(), ProjectedPoints.ToArray(), PerspectiveFactors.ToArray());
    List<Point3d> points = new List<Point3d>();
    List<Mesh> meshes = new List<Mesh>();
    Polyline[] curves;

    foreach(Point3d p in Points){
      points.Add(Perspective.Project(p));
    }
    foreach(Mesh m in Meshes){
      meshes.Add(Perspective.ProjectMesh(m));
    }
    curves = Perspective.ProjectCurves(Curves.ToArray(), Tolerance);

    Points_ = points;
    Curves_ = curves;
    Meshes_ = meshes;
# ---------- end _3points_perspective ----------
fisheye_perspective = CSharpScript(
    Curves=polylines,
    Points=points,
    Meshes=meshes,
    Tolerance="10",
    Eye=eye,
    Target=target,
    DestinationCenter=fe_destination_center,
    DestinationRadius=fe_destination_radius,
    Reference="D:\desktop\Portfolio\5. Perspective Maker\Integrated\24-07-02 Perspective Projection.dll")  # -> out, Points, Curves, Meshes; inputs Curves: list of Curve, Points: list of Point3d, Meshes: list of Mesh, Tolerance: Double, Eye: Point3d, Target: Point3d, DestinationCenter: Point3d, DestinationRadius: Double
# ---------- fisheye_perspective: C# ----------
    FishEye Perspective = new PeHash.FishEye(Eye, Target, DestinationCenter, DestinationRadius);
    List<Point3d> points = new List<Point3d>();
    List<Mesh> meshes = new List<Mesh>();
    Polyline[] curves;

    foreach(Point3d p in Points){
      points.Add(Perspective.Project(p));
    }
    foreach(Mesh m in Meshes){
      meshes.Add(Perspective.ProjectMesh(m));
    }
    curves = Perspective.ProjectCurves(Curves.ToArray(), Tolerance);

    Points_ = points;
    Curves_ = curves;
    Meshes_ = meshes;
# ---------- end fisheye_perspective ----------
preview_4 = CustomPreview(Geometry=_3points_perspective.Meshes, Material=ColourSwatch(SwatchColor=RGB(255, 255, 255)))
preview_5 = CustomPreview(Geometry=fisheye_perspective.Meshes, Material=ColourSwatch(SwatchColor=RGB(255, 255, 255)))
preview_6 = CustomPreview(Geometry=_3points_perspective.Curves, Material=ColourSwatch(SwatchColor=RGB(0, 0, 0)))
preview_7 = CustomPreview(Geometry=_2points_perspective.Meshes, Material=ColourSwatch(SwatchColor=RGB(255, 255, 255)))
preview_8 = CustomPreview(Geometry=fisheye_perspective.Curves, Material=ColourSwatch(SwatchColor=RGB(0, 0, 0)))
preview_9 = CustomPreview(Geometry=_2points_perspective.Curves, Material=ColourSwatch(SwatchColor=RGB(0, 0, 0)))

# ==== cluster Preview
destination_points_o_x_y_z = ClusterInput()
main_points_o_x_y_z = ClusterInput()
relay = ClusterInput()
item = ListItem(List=destination_points_o_x_y_z, Index=1, Wrap=True)  # -> Item, Item1, Item2
item_2 = ListItem(List=destination_points_o_x_y_z, Index=0, Wrap=True)
vec2pt = Vector2Pt(PointA=item_2, PointB=[item.Item, item.Item1, item.Item2], Unitize=False)  # -> Vector, Length
multiplication = Multiplication(A=vec2pt.Vector, B=relay)
move = Move(Geometry=item_2, Motion=multiplication)  # -> Geometry, Transform
tag = TextTag(Location=destination_points_o_x_y_z, Text=["O", "X", "Y", "Z"])
tag_2 = TextTag(Location=main_points_o_x_y_z, Text=["O", "X", "Y", "Z"])

# ==== cluster Preview_2
target = ClusterInput()
eye = ClusterInput()
destination_center = ClusterInput()
destination_radius = ClusterInput()

target_2 = Point(target)
eye_2 = Point(eye)
vec2pt = Vector2Pt(PointA=eye_2, PointB=target_2, Unitize=True)  # -> Vector, Length
pl = PlaneNormal(Origin=eye_2, ZAxis=vec2pt.Vector)
arc = Arc(Plane=pl, Radius="50", Angle=Domain(0, 3.141592654))  # -> Arc, Length
end = EndPoints(Curve=arc.Arc)  # -> Start, End
ln = Line(StartPoint=end.End, EndPoint=end.Start)
cir = Circle(Plane=pl, Radius="50")
revsrf = Revolution(Curve=arc.Arc, Axis=ln, Domain=Domain(0, 3.141592654))
boundary = BoundarySurfaces(Edges=cir)

order = PointOrder(Points=[eye_2, target_2])
cir_2 = Circle(Plane=destination_center, Radius=destination_radius)

# ==== cluster Preview_3
relay = ClusterInput()
relay_2 = ClusterInput()
relay_3 = ClusterInput()
relay_4 = ClusterInput()
relay_5 = ClusterInput()
Z = UnitZ(Factor=relay_5)
move = Move(Geometry=relay_4, Motion=Z)  # -> Geometry, Transform
X = UnitX(Factor=expr("-x", relay_2))
Y = UnitY(Factor=expr("-x", relay_3))
X_2 = UnitX(Factor=relay_2)
deplane = DeconstructPlane(Plane=move.Geometry)  # -> Origin, XAxis, YAxis, ZAxis
amp = Amplitude(Vector=deplane.XAxis, Amplitude="50")
move_2 = Move(Geometry=relay, Motion=X_2)  # -> Geometry, Transform
move_3 = Move(Geometry=relay, Motion=Y)  # -> Geometry, Transform
move_4 = Move(Geometry=relay, Motion=X)  # -> Geometry, Transform
amp_2 = Amplitude(Vector=deplane.YAxis, Amplitude="50")
move_5 = Move(Geometry=deplane.Origin, Motion=[amp, amp_2])  # -> Geometry, Transform
ln = Line(StartPoint=move_4.Geometry, EndPoint=move_2.Geometry)
ln_2 = Line(StartPoint=move_3.Geometry, EndPoint=move_2.Geometry)
ln_3 = Line(StartPoint=move_3.Geometry, EndPoint=move_4.Geometry)
vdis = VectorDisplay(Anchor=deplane.Origin, Vector=amp)
vdis_2 = VectorDisplay(Anchor=deplane.Origin, Vector=amp_2)
tag = TextTag(Location=[deplane.Origin, move_5.Geometry], Text=["O", "X", "Y"])

# ==== cluster PreparePlane
curve = ClusterInput()
explode = Explode(Curve=curve, Recursive=True)  # -> Segments, Vertices
list_item = ListItem(List=explode.Vertices, Index=0, Wrap=True)  # -> Item, Item1, Item2
vector_2pt = Vector2Pt(PointA=list_item.Item2, PointB=list_item.Item, Unitize=True)  # -> Vector, Length
vector_2pt_2 = Vector2Pt(PointA=list_item.Item2, PointB=list_item.Item1, Unitize=True)  # -> Vector, Length
construct_plane = ConstructPlane(Origin=list_item.Item2, XAxis=vector_2pt_2.Vector, YAxis=vector_2pt.Vector)
plane = ClusterOutput(construct_plane)
